# Grasshopper definition 170220_arduino_communication.gh (Grasshopper 0.9.76)
# plug-ins: Python Interpreter

# ----
# . . . . . . . . . . . . . . . . . . . . . .
# .                                         .
# .   <<  <<><><>  <<      ><  <<      ><   .
# .   <<  <<       < ><   ><<  < ><   ><<   .
# .   <<  <<><><>  << >< > ><  << >< > ><   .
# .   <<  <<       <<  ><  ><  <<  ><  ><   .
# .   <<  <<       <<      ><  <<      ><   .
# .   <<  <<       <<      ><  <<      ><   .
# .                                         .
# .             GKR 2016/17                 .
# . . . . . . . . . . . . . . . . . . . . . .
# 
# Created on 03.11.2016
# 
# @author: kathrind
unload_if_mm_lib = Button()
py = PythonScript(unload=unload_if_mm_lib)
# ---------- py: Python ----------
from ifmm_lib.useful import unload_ifmm_lib

if unload:
    unload_ifmm_lib()
# ---------- end py ----------

list = ValueList({"192.168.125.10", "127.0.0.1"}, selected="192.168.125.10")
# Arduino
# Communication
button = Button()
send_cmd_feed_cut_weld = Button()  # disabled

motor_angle = Slider(0, range=-1000..1000)
send_rotate_motor_abs = Button()
send_rotate_motor_rel = Button()
list_2 = ValueList({"m_front", "m_back"}, selected="m_back")

bend_angle = Slider(30, range=-1000..1000)
send_cmd_bend = Button()

wire_feed_len_mm = Slider(10, range=-100..100)
send_eject_wire = Button()
send_load_wire = Button()
send_feed_wire = Button()

# ----
# Don't use DO on/off
# anymore, they activate
# the relais immediately,
# and don't ask for fail
# safe booleans
list_3 = ValueList({"DO 4 _ move nippers to front": 4, "DO 7 _ nippers cut": 7, "DO 8 _ not used": 8, "DO 12 _ WELD": 12}, selected="DO 12 _ WELD")  # disabled
set_do_off = Button()  # disabled
set_do_on = Button()  # disabled

send_cmd_weld = Button()  # disabled

nippers_backward = Button()
nippers_forward = Button()
nippers_release = Button()
nippers_cut = Button()

send_reset_encoder = Button()
get_encoder_values = Button()
arduino = PythonScript(init=button, ip_arduino=list)  # -> out, bang; inputs init: Boolean
# ---------- arduino: Python ----------
from ifmm_lib.clients.arduino.communication.arduinoclient import ArduinoClient

print ip_arduino
from scriptcontext import sticky as st

arduino = ArduinoClient(host=ip_arduino, port=30001)
st["arduino"] = arduino
# ---------- end arduino ----------

electrodes_close = Button()
electrodes_open = Button()
electrodes_stop = Button()

get_info_msg = Button()
test_connection = Button()
# test connection
# until succes == True!
disconnect = Button()
connect = Button()
arduino_communication_testbed = PythonScript(
    init=arduino.bang,
    send_get_info=get_info_msg,
    do_num=list_3,
    send_set_do_on=set_do_on,
    send_set_do_off=set_do_off,
    motor_type=list_2,
    angle_val=motor_angle,
    send_cmd_rotate_motor_abs=send_rotate_motor_abs,
    send_cmd_rotate_motor_rel=send_rotate_motor_rel,
    send_cmd_feed_cut_weld=send_cmd_feed_cut_weld,
    send_electrodes_close=electrodes_close,
    send_electrodes_open=electrodes_open,
    send_electrodes_stop=electrodes_stop,
    send_nippers_forward=nippers_forward,
    send_nippers_backward=nippers_backward,
    send_nippers_cut=nippers_cut,
    send_nippers_release=nippers_release,
    feed_len=wire_feed_len_mm,
    send_feed_wire=send_feed_wire,
    send_eject_wire=send_eject_wire,
    send_load_wire=send_load_wire,
    bend_angle=bend_angle,
    send_bend=send_cmd_bend,
    send_weld=send_cmd_weld,
    send_reset_encoder=send_reset_encoder,
    send_get_encoder_values=get_encoder_values,
    wait_for_response=Toggle(False))  # -> out; inputs send_get_info: Boolean, send_cmd_rotate_motor_abs: Boolean, send_cmd_rotate_motor_rel: Boolean, send_electrodes_close: Boolean, send_electrodes_open: Boolean, send_electrodes_stop: Boolean, send_eject_wire: Boolean, send_load_wire: Boolean, send_reset_encoder: Boolean
# ---------- arduino_communication_testbed: Python ----------
import Rhino.Geometry as rg
from scriptcontext import sticky as st

from ifmm_lib.clients.clientstates import states_dict, READY, BUSY
from ifmm_lib.clients.arduino.communication.messagetypes import arduino_msg_type_dict, MSG_CMD_RECEIVED, MSG_CMD_EXECUTED, MSG_DIGITAL_OUT, MSG_INFO, MSG_STRING, MSG_FLOAT_LIST

arduino = st["arduino"]

# =========================================================================================    
if send_get_info == True:
    if arduino.is_connected() == False:
       arduino.connect()
    msg_type, msg, success = arduino.send_get_arduino_info()
    if success:
        print "RECEIVED MSG FROM ARDUINO: "
        print "MSG TYPE: ", arduino_msg_type_dict[msg_type]
        print "MSG COUNTER: ", msg[0]
        print "MSG: ", msg[1]
        arduino.info_msg = msg[1]
    else:
        print "MSG WAS NOT RECEIVED BY ARDUINO"
        arduino.info_msg = "UNABLE TO SEND MSG"


# =========================================================================================    
if send_cmd_rotate_motor_abs == True:
    if arduino.is_connected() == False:
       arduino.connect()
       
    if motor_type == "m_front":
        msg_type, msg_counter, success = arduino.send_cmd_rotate_m_front_abs(angle=angle_val, wait_for_response=wait_for_response)
    elif motor_type == "m_back":
        msg_type, msg_counter, success = arduino.send_cmd_rotate_m_back_abs(angle=angle_val, wait_for_response=wait_for_response)
        
        # alternative to check the ratio --> still needs to be checked!!
        #angle_per_step = (1.8/4)/8
        #motor_pos = arduino.get_motor_pos_value_from_angle(angle_val, angle_per_step)
        #motor_pos = motor_pos * 34./29.
        #msg_type, msg_counter, success = arduino.send_cmd_rotate_motor_abs_pos(motor_pos = motor_pos, motor_num=2, wait_for_response = wait_for_response)
    
    else:
        success = False
    #msg_type, msg_counter, success = arduino.send_cmd_rotate_motor_rel(angle=angle_val, motor_num = 1, angle_per_step = (1.8/4)/8, wait_for_response=wait_for_response)
   
    if success:
        print "RECEIVED MSG FROM ARDUINO: "
        print "MSG TYPE: ", arduino_msg_type_dict[msg_type]
        print "MSG COUNTER: ", msg_counter
        arduino.info_msg = "SENT CMD: " + str(msg_counter)
    else:
        print "MSG WAS NOT RECEIVED BY ARDUINO"
        arduino.info_msg = "UNABLE TO SEND MSG"

# =========================================================================================    
if send_cmd_rotate_motor_rel == True:
    if arduino.is_connected() == False:
       arduino.connect()
    
    if motor_type == "m_front":
        msg_type, msg_counter, success = arduino.send_cmd_rotate_m_front_rel(angle=angle_val, wait_for_response=wait_for_response)
    elif motor_type == "m_back":
        msg_type, msg_counter, success = arduino.send_cmd_rotate_m_back_rel(angle=angle_val, wait_for_response=wait_for_response)
    else:
        success = False
    #msg_type, msg_counter, success = arduino.send_cmd_rotate_motor_rel(angle=angle_val, motor_num = 1, angle_per_step = (1.8/4)/8, wait_for_response=wait_for_response)
    
    if success:
        print "RECEIVED MSG FROM ARDUINO: "
        print "MSG TYPE: ", arduino_msg_type_dict[msg_type]
        print "MSG COUNTER: ", msg_counter
        arduino.info_msg = "SENT CMD: " + str(msg_counter)
    else:
        print "MSG WAS NOT RECEIVED BY ARDUINO"
        arduino.info_msg = "UNABLE TO SEND MSG"


# =========================================================================================    
if send_bend == True:
    if arduino.is_connected() == False:
       arduino.connect()

    msg_type, msg_counter, success = arduino.send_cmd_bend(bend_angle, wait_for_response = wait_for_response)
    
    if success:
        print "RECEIVED MSG FROM ARDUINO: "
        print "MSG TYPE: ", arduino_msg_type_dict[msg_type]
        print "MSG COUNTER: ", msg_counter
        arduino.info_msg = "SENT CMD: " + str(msg_counter)
    else:
        print "MSG WAS NOT RECEIVED BY ARDUINO"
        arduino.info_msg = "UNABLE TO SEND MSG"

# =========================================================================================    
if send_cmd_feed_cut_weld == True:
    if arduino.is_connected() == False:
       arduino.connect()
    
    msg_type, msg_counter, success = arduino.send_cmd_feed_cut_weld(feed_len, wait_for_response = wait_for_response)
    
    if success:
        print "RECEIVED MSG FROM ARDUINO: "
        print "MSG TYPE: ", arduino_msg_type_dict[msg_type]
        print "MSG COUNTER: ", msg_counter
        arduino.info_msg = "SENT CMD: " + str(msg_counter)
    else:
        print "MSG WAS NOT RECEIVED BY ARDUINO"
        arduino.info_msg = "UNABLE TO SEND MSG"

# =========================================================================================    
if send_feed_wire == True:
    if arduino.is_connected() == False:
       arduino.connect()
    
    msg_type, msg_counter, success = arduino.send_cmd_feed_wire(feed_len, wait_for_response = wait_for_response)
    
    if success:
        print "RECEIVED MSG FROM ARDUINO: "
        print "MSG TYPE: ", arduino_msg_type_dict[msg_type]
        print "MSG COUNTER: ", msg_counter
        arduino.info_msg = "SENT CMD: " + str(msg_counter)
    else:
        print "MSG WAS NOT RECEIVED BY ARDUINO"
        arduino.info_msg = "UNABLE TO SEND MSG"

# =========================================================================================    
if send_eject_wire == True:
    if arduino.is_connected() == False:
       arduino.connect()
    
    msg_type, msg_counter, success = arduino.send_cmd_eject_wire(wait_for_response = wait_for_response)
    
    if success:
        print "RECEIVED MSG FROM ARDUINO: "
        print "MSG TYPE: ", arduino_msg_type_dict[msg_type]
        print "MSG COUNTER: ", msg_counter
        arduino.info_msg = "SENT CMD: " + str(msg_counter)
    else:
        print "MSG WAS NOT RECEIVED BY ARDUINO"
        arduino.info_msg = "UNABLE TO SEND MSG"

# =========================================================================================    
if send_load_wire == True:
    if arduino.is_connected() == False:
       arduino.connect()
    
    msg_type, msg_counter, success = arduino.send_cmd_load_wire(wait_for_response = wait_for_response)
    
    if success:
        print "RECEIVED MSG FROM ARDUINO: "
        print "MSG TYPE: ", arduino_msg_type_dict[msg_type]
        print "MSG COUNTER: ", msg_counter
        arduino.info_msg = "SENT CMD: " + str(msg_counter)
    else:
        print "MSG WAS NOT RECEIVED BY ARDUINO"
        arduino.info_msg = "UNABLE TO SEND MSG"

# =========================================================================================
if send_set_do_off == True:
    if arduino.is_connected() == False:
        arduino.connect()
    msg_type, msg_counter, success = arduino.send_set_do(do = do_num, state = 0, wait_for_response=wait_for_response)
    arduino.info_msg = "SET DO OFF" if success else "UNABLE TO SEND MSG"
    
# =========================================================================================
if send_set_do_on == True:
    if arduino.is_connected() == False:
        arduino.connect()
    msg_type, msg_counter, success = arduino.send_set_do(do = do_num, state = 1, wait_for_response=wait_for_response)
    arduino.info_msg = "SET DO ON" if success else "UNABLE TO SEND MSG"

# =========================================================================================
if send_electrodes_close == True:
    if arduino.is_connected() == False:
        arduino.connect()
    msg_type, msg_counter, success = arduino.send_electrodes_close(wait_for_response=wait_for_response)
    arduino.info_msg = "CLOSED ELECTRODES" if success else "UNABLE TO SEND MSG"
    
# =========================================================================================
if send_electrodes_open == True:
    if arduino.is_connected() == False:
        arduino.connect()
    msg_type, msg_counter, success = arduino.send_electrodes_open(wait_for_response=wait_for_response)
    arduino.info_msg = "OPENED ELECTRODES" if success else "UNABLE TO SEND MSG"

# =========================================================================================
if send_electrodes_stop == True:
    if arduino.is_connected() == False:
        arduino.connect()
    msg_type, msg_counter, success = arduino.send_electrodes_stop(wait_for_response=wait_for_response)
    arduino.info_msg = "STOPPED ELECTRODES" if success else "UNABLE TO SEND MSG"

# =========================================================================================
if send_nippers_forward == True:
    if arduino.is_connected() == False:
        arduino.connect()
    msg_type, msg_counter, success = arduino.send_nippers_move_to_front(wait_for_response=wait_for_response)
    arduino.info_msg = "NIPPERS MOVED TO FRONT" if success else "UNABLE TO SEND MSG"

# =========================================================================================
if send_nippers_backward == True:
    if arduino.is_connected() == False:
        arduino.connect()
    msg_type, msg_counter, success = arduino.send_nippers_move_to_back(wait_for_response=wait_for_response)
    arduino.info_msg = "NIPPERS MOVED TO BACK" if success else "UNABLE TO SEND MSG"

# =========================================================================================
if send_nippers_cut == True:
    if arduino.is_connected() == False:
        arduino.connect()
    msg_type, msg_counter, success = arduino.send_nippers_cut(wait_for_response=wait_for_response)
    arduino.info_msg = "NIPPERS CUT" if success else "UNABLE TO SEND MSG"

# =========================================================================================
if send_nippers_release == True:
    if arduino.is_connected() == False:
        arduino.connect()
    msg_type, msg_counter, success = arduino.send_nippers_release(wait_for_response=wait_for_response)
    arduino.info_msg = "NIPPERS RELEASED" if success else "UNABLE TO SEND MSG"

    
# =========================================================================================    
if send_weld == True:
    if arduino.is_connected() == False:
       arduino.connect()

    msg_type, msg_counter, success = arduino.send_cmd_weld(wait_for_response = wait_for_response)
    
    if success:
        print "RECEIVED MSG FROM ARDUINO: "
        print "MSG TYPE: ", arduino_msg_type_dict[msg_type]
        print "MSG COUNTER: ", msg_counter
        arduino.info_msg = "SENT CMD: " + str(msg_counter) 
    else:
        print "UNABLE TO SEND MSG"
        arduino.info_msg = "UNABLE TO SEND MSG"
        

# =========================================================================================    
if send_reset_encoder == True:
    if arduino.is_connected() == False:
       arduino.connect()

    msg_type, msg_counter, success = arduino.send_cmd_reset_encoder(wait_for_response = wait_for_response)
    
    if success:
        print "RECEIVED MSG FROM ARDUINO: "
        print "MSG TYPE: ", arduino_msg_type_dict[msg_type]
        print "MSG COUNTER: ", msg_counter
        arduino.info_msg = "SENT CMD: " + str(msg_counter) 
    else:
        print "UNABLE TO SEND MSG"
        arduino.info_msg = "UNABLE TO SEND MSG"
        

# =========================================================================================    
if send_get_encoder_values == True:
    if arduino.is_connected() == False:
       arduino.connect()
    msg_type, msg, success = arduino.send_get_encoder_values()
    if success:
        print "RECEIVED MSG FROM ARDUINO: "
        print "MSG TYPE: ", arduino_msg_type_dict[msg_type]
        print "MSG COUNTER: ", msg[0]
        print "ENCODER VALUE: ", msg[1]
        arduino.info_msg = msg[1]
    else:
        print "MSG WAS NOT RECEIVED BY ARDUINO"
        arduino.info_msg = "UNABLE TO SEND MSG"



##########################################################################################################
print "ARDUINO CONNECTION STATE:", arduino.is_connected()
print "ANGLE VAL:", angle_val
print "MOTOR POS VAL", arduino.get_motor_pos_value_from_angle(angle_val, angle_per_step = (1.8/4)/8 * 29./34.)
#print "MOTOR POS VAL", arduino.get_motor_pos_value_from_angle_old(angle_val) * 8
#if len(arduino.info_msg):
print "ARDUINO INFO MSG:", arduino.info_msg
# ---------- end arduino_communication_testbed ----------
arduino_2 = PythonScript(init=arduino.bang, connect=connect, close=disconnect, test_connection=test_connection)  # -> out; inputs connect: Boolean, close: Boolean
# ---------- arduino_2: Python ----------
import Rhino.Geometry as rg
from scriptcontext import sticky as st

arduino = st["arduino"]

# =========================================================================================    
if connect == True:
    if arduino.is_connected() == False:
       #arduino.connect()
       test_connection = True

# =========================================================================================    
if close == True:
    if arduino.connected == True:
        arduino.close()

# =========================================================================================    
if test_connection == True:
    if arduino.is_connected() == False:
        arduino.reset()

connection_state = "online" if arduino.is_connected() else "offline"
print "ARDUINO CONNECTION STATE:", connection_state
# ---------- end arduino_2 ----------
panel = Panel(arduino_2)
panel_2 = Panel(arduino_communication_testbed)
