# Grasshopper definition arduino_communication-anw.gh (Grasshopper 0.9.76)
# plug-ins: Python Interpreter

# ----
# . . . . . . . . . . . . . . . . . . . . . .
# .                                         .
# .   <<  <<><><>  <<      ><  <<      ><   .
# .   <<  <<       < ><   ><<  < ><   ><<   .
# .   <<  <<><><>  << >< > ><  << >< > ><   .
# .   <<  <<       <<  ><  ><  <<  ><  ><   .
# .   <<  <<       <<      ><  <<      ><   .
# .   <<  <<       <<      ><  <<      ><   .
# .                                         .
# .             GKR 2016/17                 .
# . . . . . . . . . . . . . . . . . . . . . .
# 
# Created on 03.11.2016
# 
# @author: kathrind
unload_if_mm_lib = Button()
py = PythonScript(unload=unload_if_mm_lib)
# ---------- py: Python ----------
from ifmm_lib.useful import unload_ifmm_lib

if unload:
    unload_ifmm_lib()
# ---------- end py ----------

motor_angle = Slider(0, range=-1000..1000)
send_rotate_motor_abs = Button()
send_rotate_motor_rel = Button()
list = ValueList({"m_front", "m_back"}, selected="m_back")

# ----
# Arduino
# Communication
list_2 = ValueList({"192.168.125.10", "127.0.0.1"}, selected="192.168.125.10")

set_do_off = Button()
set_do_on = Button()
list_3 = ValueList({"DO 4 _ move nippers to front": 4, "DO 7 _ nippers cut": 7, "DO 8 _ not used": 8, "DO 12 _ WELD": 12}, selected="DO 4 _ move nippers to front")

wire_feed_len_mm = Slider(50, range=-100..100)
send_eject_wire = Button()
send_load_wire = Button()
send_feed_wire = Button()

electrodes_close = Button()
electrodes_open = Button()
electrodes_stop = Button()

get_info_msg = Button()

nippers_backward = Button()
nippers_cut_release = Button()
nippers_forward = Button()
nippers_cut = Button()

arduino = PythonScript(init=Button(), ip_arduino=list_2)  # -> out, bang; inputs init: Boolean
# ---------- arduino: Python ----------
from ifmm_lib.clients.arduino.communication.arduinoclient import ArduinoClient

print ip_arduino
from scriptcontext import sticky as st

arduino = ArduinoClient(host=ip_arduino, port=30001)
st["arduino"] = arduino
# ---------- end arduino ----------
# test connection
# until succes == True!
test_connection = Button()
disconnect = Button()
connect = Button()
arduino_communication_testbed = PythonScript(
    init=arduino.bang,
    send_get_info=get_info_msg,
    do_num=list_3,
    send_set_do_on=set_do_on,
    send_set_do_off=set_do_off,
    send_electrodes_close=electrodes_close,
    send_electrodes_open=electrodes_open,
    send_electrodes_stop=electrodes_stop,
    send_nippers_forward=nippers_forward,
    send_nippers_backward=nippers_backward,
    send_nippers_cut=nippers_cut,
    motor_type=list,
    angle_val=motor_angle,
    send_cmd_rotate_motor_abs=send_rotate_motor_abs,
    send_cmd_rotate_motor_rel=send_rotate_motor_rel,
    feed_len=wire_feed_len_mm,
    send_feed_wire=send_feed_wire,
    send_eject_wire=send_eject_wire,
    send_load_wire=send_load_wire,
    wait_for_response=Toggle(False))  # -> out; inputs send_get_info: Boolean, send_electrodes_close: Boolean, send_electrodes_open: Boolean, send_electrodes_stop: Boolean, send_cmd_rotate_motor_abs: Boolean, send_eject_wire: Boolean, send_load_wire: Boolean
# ---------- arduino_communication_testbed: Python ----------
import Rhino.Geometry as rg
from scriptcontext import sticky as st

from ifmm_lib.clients.arduino.communication.clientstates import states_dict, READY, BUSY
from ifmm_lib.clients.arduino.communication.messagetypes import arduino_msg_id_dict, MSG_CMD_RECEIVED, MSG_CMD_EXECUTED, MSG_DIGITAL_OUT, MSG_INFO, MSG_STRING, MSG_FLOAT_LIST

arduino = st["arduino"]

# =========================================================================================    
if send_get_info == True:
    if arduino.connected == False:
       arduino.connect()
    msg_id, msg, success = arduino.send_get_arduino_info()
    if success:
        print "RECEIVED MSG FROM ARDUINO: "
        print "MSG TYPE: ", arduino_msg_id_dict[msg_id]
        print "MSG COUNTER: ", msg[0]
        print "MSG: ", msg[1]
        arduino.info_msg = msg[1]
    else:
        print "MSG WAS NOT RECEIVED BY ARDUINO"
        arduino.info_msg = "NO MSG"        


# =========================================================================================    
if send_cmd_rotate_motor_abs == True:
    if arduino.connected == False:
       arduino.connect()
       
    if motor_type == "m_front":
        msg_id, msg_counter, success = arduino.send_cmd_rotate_m_front_abs(angle=angle_val, wait_for_response=wait_for_response)
    elif motor_type == "m_back":
        msg_id, msg_counter, success = arduino.send_cmd_rotate_m_back_abs(angle=angle_val, wait_for_response=wait_for_response)
        
        # alternative to check the ratio --> still needs to be checked!!
        #angle_per_step = (1.8/4)/8
        #motor_pos = arduino.get_motor_pos_value_from_angle(angle_val, angle_per_step)
        #motor_pos = motor_pos * 34./29.
        #msg_id, msg_counter, success = arduino.send_cmd_rotate_motor_abs_pos(motor_pos = motor_pos, motor_num=2, wait_for_response = wait_for_response)
    
    else:
        success = False
    #msg_id, msg_counter, success = arduino.send_cmd_rotate_motor_rel(angle=angle_val, motor_num = 1, angle_per_step = (1.8/4)/8, wait_for_response=wait_for_response)
   
    if success:
        print "RECEIVED MSG FROM ARDUINO: "
        print "MSG TYPE: ", arduino_msg_id_dict[msg_id]
        print "MSG COUNTER: ", msg_counter
        arduino.info_msg = "SENT CMD: " + str(msg_counter)
    else:
        print "MSG WAS NOT RECEIVED BY ARDUINO"
        arduino.info_msg = "NO MSG"

# =========================================================================================    
if send_cmd_rotate_motor_rel == True:
    if arduino.connected == False:
       arduino.connect()
    
    if motor_type == "m_front":
        msg_id, msg_counter, success = arduino.send_cmd_rotate_m_front_rel(angle=angle_val, wait_for_response=wait_for_response)
    elif motor_type == "m_back":
        msg_id, msg_counter, success = arduino.send_cmd_rotate_m_back_rel(angle=angle_val, wait_for_response=wait_for_response)
    else:
        success = False
    #msg_id, msg_counter, success = arduino.send_cmd_rotate_motor_rel(angle=angle_val, motor_num = 1, angle_per_step = (1.8/4)/8, wait_for_response=wait_for_response)
    
    if success:
        print "RECEIVED MSG FROM ARDUINO: "
        print "MSG TYPE: ", arduino_msg_id_dict[msg_id]
        print "MSG COUNTER: ", msg_counter
        arduino.info_msg = "SENT CMD: " + str(msg_counter)
    else:
        print "MSG WAS NOT RECEIVED BY ARDUINO"
        arduino.info_msg = "NO MSG"


# =========================================================================================    
if send_feed_wire == True:
    if arduino.connected == False:
       arduino.connect()
    
    msg_id, msg_counter, success = arduino.send_cmd_feed_wire(feed_len, wait_for_response = wait_for_response)
    
    if success:
        print "RECEIVED MSG FROM ARDUINO: "
        print "MSG TYPE: ", arduino_msg_id_dict[msg_id]
        print "MSG COUNTER: ", msg_counter
        arduino.info_msg = "SENT CMD: " + str(msg_counter)
    else:
        print "MSG WAS NOT RECEIVED BY ARDUINO"
        arduino.info_msg = "NO MSG"

# =========================================================================================    
if send_eject_wire == True:
    if arduino.connected == False:
       arduino.connect()
    
    msg_id, msg_counter, success = arduino.send_cmd_eject_wire(wait_for_response = wait_for_response)
    
    if success:
        print "RECEIVED MSG FROM ARDUINO: "
        print "MSG TYPE: ", arduino_msg_id_dict[msg_id]
        print "MSG COUNTER: ", msg_counter
        arduino.info_msg = "SENT CMD: " + str(msg_counter)
    else:
        print "MSG WAS NOT RECEIVED BY ARDUINO"
        arduino.info_msg = "NO MSG"

# =========================================================================================    
if send_load_wire == True:
    if arduino.connected == False:
       arduino.connect()
    
    msg_id, msg_counter, success = arduino.send_cmd_load_wire(wait_for_response = wait_for_response)
    
    if success:
        print "RECEIVED MSG FROM ARDUINO: "
        print "MSG TYPE: ", arduino_msg_id_dict[msg_id]
        print "MSG COUNTER: ", msg_counter
        arduino.info_msg = "SENT CMD: " + str(msg_counter)
    else:
        print "MSG WAS NOT RECEIVED BY ARDUINO"
        arduino.info_msg = "NO MSG"

# =========================================================================================
if send_set_do_off == True:
    if arduino.connected == False:
        arduino.connect()
    msg_id, msg_counter, success = arduino.send_set_do(do = do_num, state = 0, wait_for_response=wait_for_response)
    arduino.info_msg = "SET DO OFF" if success else "UNABLE TO SEND MSG"
    
# =========================================================================================
if send_set_do_on == True:
    if arduino.connected == False:
        arduino.connect()
    msg_id, msg_counter, success = arduino.send_set_do(do = do_num, state = 1, wait_for_response=wait_for_response)
    arduino.info_msg = "SET DO ON" if success else "UNABLE TO SEND MSG"

# =========================================================================================
if send_electrodes_close == True:
    if arduino.connected == False:
        arduino.connect()
    msg_id, msg_counter, success = arduino.send_electrodes_close(wait_for_response=wait_for_response)
    arduino.info_msg = "CLOSED ELECTRODES" if success else "UNABLE TO SEND MSG"
    
# =========================================================================================
if send_electrodes_open == True:
    if arduino.connected == False:
        arduino.connect()
    msg_id, msg_counter, success = arduino.send_electrodes_open(wait_for_response=wait_for_response)
    arduino.info_msg = "OPENED ELECTRODES" if success else "UNABLE TO SEND MSG"

# =========================================================================================
if send_electrodes_stop == True:
    if arduino.connected == False:
        arduino.connect()
    msg_id, msg_counter, success = arduino.send_electrodes_stop(wait_for_response=wait_for_response)
    arduino.info_msg = "STOPPED ELECTRODES" if success else "UNABLE TO SEND MSG"

# =========================================================================================
if send_nippers_forward == True:
    if arduino.connected == False:
        arduino.connect()
    msg_id, msg_counter, success = arduino.send_nippers_move_to_front(wait_for_response=wait_for_response)
    arduino.info_msg = "NIPPERS MOVED TO FRONT" if success else "UNABLE TO SEND MSG"

# =========================================================================================
if send_nippers_backward == True:
    if arduino.connected == False:
        arduino.connect()
    msg_id, msg_counter, success = arduino.send_nippers_move_to_back(wait_for_response=wait_for_response)
    arduino.info_msg = "NIPPERS MOVED TO BACK" if success else "UNABLE TO SEND MSG"

# =========================================================================================
if send_nippers_cut == True:
    if arduino.connected == False:
        arduino.connect()
    msg_id, msg_counter, success = arduino.send_nippers_cut(wait_for_response=wait_for_response)
    arduino.info_msg = "NIPPERS MOVED TO BACK" if success else "UNABLE TO SEND MSG"



##########################################################################################################
print "ARDUINO CONNECTION STATE:", arduino.connected
print "ANGLE VAL:", angle_val
print "MOTOR POS VAL", arduino.get_motor_pos_value_from_angle(angle_val, angle_per_step = (1.8/4)/8 * 29./34.)
print "MOTOR POS VAL", arduino.get_motor_pos_value_from_angle_old(angle_val) * 8
if len(arduino.info_msg):
    print "ARDUINO INFO MSG:", arduino.info_msg
# ---------- end arduino_communication_testbed ----------
arduino_2 = PythonScript(init=arduino.bang, connect=connect, close=disconnect, test_connection=test_connection)  # -> out; inputs connect: Boolean, close: Boolean
# ---------- arduino_2: Python ----------
import Rhino.Geometry as rg
from scriptcontext import sticky as st

arduino = st["arduino"]


# =========================================================================================    
if connect == True:
    if arduino.connected == False:
       #arduino.connect()
       test_connection = True

# =========================================================================================    
if close == True:
    if arduino.connected == True:
        arduino.close()

# =========================================================================================    
if test_connection == True:
    if arduino.connected == False:
       arduino.connect()
    else:
        arduino.close()
        arduino.connect()
    msg_id, msg, success = arduino.send_get_arduino_info()
    if success:
        arduino.connection_success = True
    else:
        arduino.connection_success = False

print "ARDUINO CONNECTION STATE:", arduino.connection_success & arduino.connected
print "ARDUINO CONNECTION SUCCESS:", arduino.connection_success & arduino.connected
# ---------- end arduino_2 ----------
panel = Panel(arduino_2)
panel_2 = Panel(arduino_communication_testbed)
