# Grasshopper definition 170630_IFMM_Proto_AW.gh (Grasshopper 0.9.76)
# plug-ins: Python Interpreter

srf2 = Surface(<surface referenced from the Rhino model>)
srf1 = Surface(<surface referenced from the Rhino model>)
number_slider = Slider(70, range=0..100)
number_slider_2 = Slider(50, range=0..100)
mesh_uv = MeshSurface(Surface=srf1, UCount=number_slider, VCount=number_slider_2, Overhang=True, Equalize=Toggle(True))
mesh_uv_2 = MeshSurface(Surface=srf2, UCount=Slider(70, range=0..100), VCount=Slider(50, range=0..100), Overhang=True, Equalize=Toggle(True))
mmmesh = PythonScript()  # -> out, mesh
# ---------- mmmesh: Python ----------
import Rhino.Geometry as rg
import math

class MMMesh: 
    
    #===========================================================================
    # MM Mesh
    #===========================================================================
    def __init__(self):
        ''' generation geometry of a mesh mould mesh '''

    #===========================================================================
    # setting the fab meshes with number of rows, cols and cutting planes
    #===========================================================================
    def set_mesh_geo(self, mesh1, mesh2, srf1, srf2, u_count, v_count):
        
        # rhino mesh
        self.mesh1 = mesh1
        self.mesh2 = mesh2
        
        # rhino srf
        self.srf1 = srf1
        self.srf2 = srf2
               
        # number of u and v
        self.u_count = u_count+1 # is the division in the discrete direction # vertical division along the motion path #rows
        self.v_count = v_count+1 # is the division in the continuous direction * 2 for subdivision # horizontal division #cols
    
        print "u count: ", self.u_count
        print "v count: ", self.v_count
        
    def get_plane_from_srf(self, pt, srf_number):
        '''get the srf plane closest tot the input point'''
        
        if srf_number == 1:
            srf = self.srf1
        else:
            srf = self.srf2
        
        srf_param = srf.ClosestPoint(pt)
        srf_plane = srf.FrameAt(srf_param[1], srf_param[2])[1]
        
        srf_plane.Rotate(math.radians(90), srf_plane.ZAxis, srf_plane.Origin)
        srf_plane.Rotate(math.radians(90), srf_plane.XAxis, srf_plane.Origin)
        
        return srf_plane

    #===========================================================================
    # general mesh functions for a quadmesh with regular grid
    #===========================================================================
    def get_idx_u_v(self, u, v):
        ''' return idx in u v'''
        return u * self.v_count + v
    
    def get_vertex_u_v(self, u, v, mesh_number):
        ''' return vertex in u v'''
        mesh = self.mesh1 if mesh_number == 1 else self.mesh2
        
        idx = self.get_idx_u_v(u, v)
        return mesh.Vertices[idx]
    
    def get_pt_u_v(self, u, v, mesh_number):
        ''' return pt in u v from a regular grid'''
        
        vertex = self.get_vertex_u_v(u, v, mesh_number)
        return rg.Point3d(vertex)
    
    def get_idcs_in_u(self, u):
        ''' return idcs in u from a regular grid'''
        from_idx = u * self.v_count
        to_idx = (u + 1) * self.v_count
        return range(from_idx, to_idx)
    
    def get_idcs_in_v(self, v):
        ''' return idcs in v from a regular grid'''
        return [(i * self.v_count) + v for i in range(self.u_count)]
    
    def get_vertices_in_u(self, u, mesh_number):
        ''' return vertices in u from mesh'''
        mesh = self.mesh1 if mesh_number == 1 else self.mesh2
        return [mesh.Vertices[idx] for idx in self.get_idcs_in_u(u)]
    
    def get_vertices_in_v(self, v, mesh_number):
        ''' return vertices in v from a mesh'''  
        mesh = self.mesh1 if mesh_number == 1 else self.mesh2
        return [mesh.Vertices[idx] for idx in self.get_idcs_in_v(v)]
    
    def get_pts_in_u(self, u, mesh_number):
        ''' return pts in row from a rhino geometry quad mesh'''
        
        vertices = self.get_vertices_in_u(u, mesh_number)
        
        pts = []
        for vertex in vertices:
            pt = rg.Point3d(vertex)
            pts.append(pt)

        return pts
    
    def get_pts_in_v(self, v, mesh_number):
        ''' return pts in col from a rhino geometry quad mesh''' 
        
        vertices = self.get_vertices_in_v(v, mesh_number)
        
        pts = []
        for vertex in vertices:
            pt = rg.Point3d(vertex)
            pts.append(pt)

        return pts
    
mesh = MMMesh()
# ---------- end mmmesh ----------
python = PythonScript(m1=mesh_uv, m2=mesh_uv_2, s1=srf1, s2=srf2, u_count=number_slider, v_count=number_slider_2, mesh=mmmesh.mesh)  # -> out, mesh; inputs m1: Mesh, m2: Mesh, s1: Surface, s2: Surface, u_count: Int32, v_count: Int32
# ---------- python: Python ----------
print mesh


mesh.set_mesh_geo(m1, m2, s1, s2, u_count, v_count)
# ---------- end python ----------
python_2 = PythonScript(m=mesh_uv, s=[srf1, srf2], u_count=number_slider, v_count=number_slider_2)  # -> out, pt, plane; inputs m: list of Mesh, s: list of Surface, u_count: Int32, v_count: Int32; disabled
# ---------- python_2: Python ----------
import Rhino.Geometry as rg
import math

v_count = v_count+1
u_count = u_count+1

def get_vertex_row_col_rgmesh(rgmesh, udx, vdx, v_count):
    ''' return vertex in row col from a regular grid'''
    
    idx = udx * v_count + vdx
    return rgmesh.Vertices[idx]
    
def get_plane_from_srf(pt, srf):
    '''get the srf plane closest tot the input point'''

    srf_param = srf.ClosestPoint(pt)
    srf_plane = srf.FrameAt(srf_param[1], srf_param[2])[1]
    
    
    srf_plane.Rotate(math.radians(90), srf_plane.ZAxis, srf_plane.Origin)
    srf_plane.Rotate(math.radians(90), srf_plane.XAxis, srf_plane.Origin)
    return srf_plane

    
m1 = m[0]
s1 = s[0]

pt = get_vertex_row_col_rgmesh(m1, 3, 2, v_count)
plane = get_plane_from_srf(pt, s1)
# ---------- end python_2 ----------
pt = Point(python_2.pt)  # disabled
pln = Plane(python_2.plane)  # disabled
number_slider_3 = Slider(0, range=0..70)
list = ValueList({"side_1": 1, "side_2": 2}, selected="side_1")
list_2 = ValueList({"side_1": 1, "side_2": 2}, selected="side_2")
python_3 = PythonScript(
    mesh=python.mesh,
    side_number=list,
    u=number_slider_3,
    v=number_slider_3,
    show_pts_in_u=Toggle(True),
    show_pts_in_v=Toggle(False))  # -> out, pts, planes_in_u; inputs side_number: Int32, u: Int32, v: Int32, show_pts_in_u: Boolean, show_pts_in_v: Boolean
# ---------- python_3: Python ----------
if show_pts_in_u:
    pts = mesh.get_pts_in_u(u, side_number)

if show_pts_in_v:
    pts = mesh.get_pts_in_v(v, side_number)

print len(pts)

pt = pts[-1]

plane = mesh.get_plane_from_srf(pt, side_number)

planes_in_u = []
for pt in pts:
    plane_current = mesh.get_plane_from_srf(pt, side_number)
    planes_in_u.append(plane_current)
# ---------- end python_3 ----------
python_4 = PythonScript(
    mesh=python.mesh,
    side_number=list_2,
    u=number_slider_3,
    v=number_slider_3,
    show_pts_in_u=Toggle(True),
    show_pts_in_v=Toggle(False))  # -> out, pts, planes_in_u; inputs side_number: Int32, u: Int32, v: Int32, show_pts_in_u: Boolean, show_pts_in_v: Boolean; same code as python_3
pt_2 = Point(python_4.pts)
pln_2 = Plane(python_4.planes_in_u)
pt_3 = Point(python_3.pts)
pln_3 = Plane(python_3.planes_in_u)
shortestdistance = ShortestDistance(V=pt_3, V_2=pt_2)
# next steps:
# 
# get Edge lengths (need to be within 30mm and 45mm) in horizontal direction!
panel = Panel(shortestdistance)

# ==== cluster ShortestDistance
V = ClusterInput()
V_2 = ClusterInput()
crv = Curve(Vertices=V, Degree=3, Periodic=False)  # -> Curve, Length, Domain
crv_2 = Curve(Vertices=V_2, Degree=3, Periodic=False)  # -> Curve, Length, Domain
c_script = CSharpScript(c0=crv.Curve, c1=crv_2.Curve)  # -> out, p0, p1; inputs c0: Curve, c1: Curve
# ---------- c_script: C# ----------
    if (c0 != null && c1 != null)
    {
      Point3d v0, v1;

      if(!c0.ClosestPoints(c1, out v0, out v1)) throw new Exception("Impossible to find closest point");

      p0 = v0;
      p1 = v1;
    }
# ---------- end c_script ----------
ln = Line(PointA=c_script.p0, PointB=c_script.p1)
len = Length(Curve=ln)
L = ClusterOutput(len)
