# Grasshopper definition simple_thread.gh (Grasshopper 0.9.76)
# plug-ins: Python Interpreter

# ----
# starting and
# stopping the timer
timer = BooleanToggle(True)
# stopping the thread
stop = Button()
# start the thread
button = Button()
watch_thread_value = PythonScript(watch_thread_value=timer, stop_thread=stop)  # -> out
# ---------- watch_thread_value: Python ----------
import Grasshopper as gh
from scriptcontext import sticky as st

# =================================================================================
# GH timer
# =================================================================================
def gh_component_timer(ghenv, run, interval):
    if interval <= 0: interval = 1
    ghComp = ghenv.Component
    ghDoc = ghComp.OnPingDocument()
    def callBack(ghDoc):
        ghComp.ExpireSolution(False)
    if run:
        ghDoc.ScheduleSolution(interval, gh.Kernel.GH_Document.GH_ScheduleDelegate(callBack))

# =================================================================================
# printout
# =================================================================================
interval = 20 # timer interval
print "test value: ", st["value"]
print "thread_running" if st["thread_running"] else "thread stopped"


# =================================================================================
# start GH timer
# =================================================================================
if watch_thread_value:
    gh_component_timer(ghenv, True, 20)


# =================================================================================
# stopping the thread loop
# =================================================================================
if stop_thread and st["thread_running"] == True:
    st["break_loop"] = True
# ---------- end watch_thread_value ----------
simple_thread = PythonScript(start_thread=button)  # -> out
# ---------- simple_thread: Python ----------
from scriptcontext import sticky as st
from threading import Thread
import time

# =================================================================================
# 1 setting the sticky values
# =================================================================================
if not "value" in st:
    st["value"] = 0

if not "break_loop" in st:
    st["break_loop"] = False
    
if not "thread_running" in st:
    st["thread_running"] = False

# =================================================================================
# 2 define thread task
# =================================================================================
def do_task(arg1, arg2):
    st["thread_running"] = True
    for i in range(100):
        value = i*arg1*arg2
        st["value"] = value
        print value
        time.sleep(0.1)
        
        # necessary for clean exit of thread
        if st["break_loop"] == True:
            st["thread_running"] = False
            st["break_loop"] = False
            st["value"] = 0
            break


# =================================================================================
# 3 start thread
# =================================================================================
if start_thread and st["thread_running"] == False:
    arg1 = 3
    arg2 = 5
    t = Thread(target = do_task, args = (arg1, arg2))
    t.start()
# ---------- end simple_thread ----------
panel = Panel(watch_thread_value)
